# Grasshopper definition PathSolver_ex.gh (Grasshopper 1.0.7)
# plug-ins: Human, Pufferfish, Wombat, Heteroptera, MetaHopper, DendroGH

number_slider = Slider(1400, range=0..1400)  # disabled
domcen = CenteredDomain(DomainSize=number_slider)  # disabled
number_slider_2 = Slider(0.650684, range=0..1)  # disabled
panel = Panel("3000")  # disabled
rectangle = Rectangle(Plane=PlaneXY(0, 0, 0), XSize=domcen, YSize=domcen, Radius=0)  # -> Rectangle, Length; disabled
Z = UnitZ(Factor=panel)  # disabled
move = Move(Geometry=rectangle.Rectangle, Motion=Z)  # -> Geometry, Transform; disabled
number_slider_3 = Slider(40, range=0..40)  # disabled
number_slider_4 = Slider(6, range=0..40)  # disabled
number_slider_5 = Slider(90, range=0..90)  # disabled
number_slider_6 = Slider(6, range=0..10)  # disabled
number_slider_7 = Slider(40, range=0..100)  # disabled
boundary = BoundarySurfaces(Edges=move.Geometry)  # disabled
panel_2 = Panel("""45
7878
42356""")  # disabled
panel_3 = Panel("""0
2
43""")  # disabled
panel_4 = Panel("""34
56
5""")  # disabled
panel_5 = Panel("""6
78
890""")  # disabled
cluster = Cluster_2(geo=boundary, N=number_slider_6, S=panel_3, t=number_slider_2)  # disabled
cluster_2 = Cluster_2(geo=boundary, N=number_slider_3, S=panel_4, t=number_slider_2)  # disabled
cluster_3 = Cluster_2(geo=boundary, N=number_slider_4, S=panel_5, t=number_slider_2)  # disabled
cluster_4 = Cluster_2(geo=boundary, N=number_slider_5, S=panel_2, t=number_slider_2)  # disabled
mesh_uv = MeshSurface(Surface=boundary, UCount=number_slider_7, VCount=number_slider_7, Overhang=True, Equalize=False)  # disabled
demesh = DeconstructMesh(Mesh=mesh_uv)  # -> Vertices, Faces, Colours, Normals; disabled
pdecon = Deconstruct(Point=demesh.Vertices)  # -> XComponent, YComponent, ZComponent; disabled
cp = ClosestPoint(Point=demesh.Vertices, Cloud=cluster)  # -> ClosestPoint, CPIndex, Distance; disabled
cp_2 = ClosestPoint(Point=demesh.Vertices, Cloud=cluster_2)  # -> ClosestPoint, CPIndex, Distance; disabled
cp_3 = ClosestPoint(Point=demesh.Vertices, Cloud=cluster_3)  # -> ClosestPoint, CPIndex, Distance; disabled
cp_4 = ClosestPoint(Point=demesh.Vertices, Cloud=cluster_4)  # -> ClosestPoint, CPIndex, Distance; disabled
neg = Negative(Value=pdecon.YComponent)  # disabled
number_slider_8 = Slider(0.3, range=0..1)  # disabled
number_slider_9 = Slider(0.07, range=0..1)  # disabled
number_slider_10 = Slider(0.14, range=0..1)  # disabled
number_slider_11 = Slider(0.17, range=0..1)  # disabled
number_slider_12 = Slider(0.2, range=0..1)  # disabled
number_slider_13 = Slider(43, range=0..1000)  # disabled
multiplication = Multiplication(A=cp_3.Distance, B=number_slider_8)  # disabled
multiplication_2 = Multiplication(A=cp_4.Distance, B=number_slider_9)  # disabled
multiplication_3 = Multiplication(A=cp.Distance, B=number_slider_11)  # disabled
multiplication_4 = Multiplication(A=cp_2.Distance, B=number_slider_12)
multiplication_5 = Multiplication(A=neg, B=number_slider_10)  # disabled
addition = Addition(A=multiplication_5, B=number_slider_13)  # disabled
addition_2 = Addition(A=multiplication_3, B=multiplication_4, C=multiplication, D=multiplication_2, E=addition)  # disabled
number_slider_14 = Slider(0.43, range=0..1)  # disabled
multiplication_6 = Multiplication(A=addition_2, B=number_slider_14)  # disabled
Z_2 = UnitZ(Factor=multiplication_6)  # disabled
move_2 = Move(Geometry=demesh.Vertices, Motion=Z_2)  # -> Geometry, Transform; disabled
conmesh = ConstructMesh(Vertices=move_2.Geometry, Faces=demesh.Faces)  # disabled
crv = Curve(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)  # disabled
crv_2 = Curve(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)  # disabled
number_slider_15 = Slider(1, range=0..1)  # disabled
len = Length(Curve=crv_2)  # disabled
len_2 = Length(Curve=crv)  # disabled
vec = Vector(crv_2)  # disabled
end = EndPoints(Curve=crv)  # -> Start, End; disabled
vec_2 = Vector(crv)  # disabled
amp = Amplitude(Vector=vec, Amplitude=len)  # disabled
amp_2 = Amplitude(Vector=vec_2, Amplitude=len_2)  # disabled
pt = Point(end.Start)  # disabled
multiplication_7 = Multiplication(A=amp_2, B=number_slider_15)  # disabled
addition_3 = Addition(A=amp, B=amp_2)  # disabled
python = GhPythonScript()  # -> out, a; disabled
# ---------- python: Python ----------
import Rhino.Geometry as rg
import Rhino.UI as ui
import rhinoscriptsyntax as rs
import ghpythonlib.components as gh
import ghpythonlib.treehelpers as th
import math as ma
#import Rhino as r
#import copy
#import time
#import System
#import os

a = rg.Vector3d(0, 0, -1)
# ---------- end python ----------
vdisex = VectorDisplayEx(Point=pt, Vector=addition_3, Colour=RGB(0, 0, 0), Width=2)  # disabled

number_slider_16 = Slider(1760, range=0..4000)  # disabled
number_slider_17 = Slider(1760, range=0..4000)  # disabled
toggle = GroupToggle(ToggleActive=True, ToggleVisible=False)  # disabled
geo = Geometry(<subd referenced from the Rhino model>)  # disabled
brep = Brep(geo)  # disabled
number_slider_18 = Slider(100, range=0..100)  # disabled
smooth = SettingsQuality()  # disabled
mesh = MeshBrep(Brep=brep, Settings=smooth)  # disabled
Z_3 = UnitZ(Factor=number_slider_16)  # disabled
Z_4 = UnitZ(Factor=number_slider_17)  # disabled
center = Center(Geometric=mesh)  # -> Center, Dimension; disabled
rev = Reverse(Vector=Z_4)  # disabled
number_slider_19 = Slider(27, range=0..100)  # disabled
number_slider_20 = Slider(80, range=0..100)  # disabled
number_slider_21 = Slider(27, range=0..100)  # disabled
number_slider_22 = Slider(80, range=0..100)  # disabled
move_3 = Move(Geometry=center.Center, Motion=Z_3)  # -> Geometry, Transform; disabled
move_4 = Move(Geometry=center.Center, Motion=rev)  # -> Geometry, Transform; disabled
cir = Circle(Plane=move_4.Geometry, Radius=[number_slider_19, number_slider_20])  # disabled
cir_2 = Circle(Plane=move_3.Geometry, Radius=[number_slider_21, number_slider_22])  # disabled
boundary_2 = BoundarySurfaces(Edges=cir)  # disabled
boundary_3 = BoundarySurfaces(Edges=cir_2)  # disabled
popgeo = PopulateGeometry(Geometry=boundary_2, Count=number_slider_18, Seed=1)  # disabled
popgeo_2 = PopulateGeometry(Geometry=boundary_3, Count=number_slider_18, Seed=1)  # disabled
vec2pt = Vector2Pt(PointA=move_4.Geometry, PointB=popgeo, Unitize=False)  # -> Vector, Length; disabled
vec2pt_2 = Vector2Pt(PointA=move_3.Geometry, PointB=popgeo_2, Unitize=False)  # -> Vector, Length; disabled
pt_2 = Point(popgeo)  # disabled
vec_3 = Vector(vec2pt.Vector)  # disabled
pt_3 = Point(pt_2)  # disabled
vec_4 = Vector(vec_3)  # disabled

# ----
# Select Geometry
select_mesh = ValueList({"0", "1"}, selected="0")
number_slider_23 = Slider(35, range=0..100)  # disabled
number_slider_24 = Slider(1400, range=0..1400)  # disabled
mesh_2 = Mesh(<mesh referenced from the Rhino model>)  # disabled
mesh_3 = Mesh(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)
mesh_4 = Mesh(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)
number_slider_25 = Slider(1400, range=0..1400)  # disabled
filter = StreamFilter(Gate=select_mesh, Stream0=mesh_3, Stream1=mesh_4)
qrmesh = QuadRemesh(Mesh=mesh_2, Settings={aqc=True, as=50, dhe=True, gci=0, null=False, pme=0, sa=0, tqc=2000})  # disabled
pipeline = GeometryPipeline(
    GroupByLayer=False,
    GroupByType=False,
    IncludeHidden=True,
    IncludeLocked=True,
    LayerFilter="Geo",
    NameFilter="*",
    SublayerFiltering=True,
    TypeFilter=1073741848)  # disabled
custom_mesh_settings = SettingsCustom(
    StitchSeams=True,
    SimplePlanes=False,
    Refine=True,
    MinCount=number_slider_23,
    MaxCount=400,
    AspectRatio=20,
    MaxDistance=0,
    MaxAngle=20,
    MinEdge=0,
    MaxEdge=0)  # disabled
domcen_2 = CenteredDomain(DomainSize=number_slider_24)  # disabled

number_slider_26 = Slider(27, range=0..100)  # disabled
number_slider_27 = Slider(80, range=0..100)  # disabled
toggle_2 = GroupToggle(ToggleActive=True, ToggleVisible=False)  # disabled
geo_2 = Geometry(<subd referenced from the Rhino model>)  # disabled
pt_4 = Point(Point(-18.8889537, 184.3972794, 1608.796573))  # disabled
brep_2 = Brep(geo_2)  # disabled
smooth_2 = SettingsQuality()  # disabled
cir_3 = Circle(Plane=pt_4, Radius=[number_slider_26, number_slider_27])  # disabled
number_slider_28 = Slider(10, range=0..10)  # disabled
mesh_5 = MeshBrep(Brep=brep_2, Settings=smooth_2)  # disabled
boundary_4 = BoundarySurfaces(Edges=cir_3)  # disabled
mesh_6 = Mesh(mesh_5)  # disabled
popgeo_3 = PopulateGeometry(Geometry=boundary_4, Count=number_slider_28, Seed=1)  # disabled
vec2pt_3 = Vector2Pt(PointA=pt_4, PointB=popgeo_3, Unitize=False)  # -> Vector, Length; disabled
pt_5 = Point(popgeo_3)  # disabled
vec_5 = Vector(vec2pt_3.Vector)  # disabled
mesh_7 = Mesh(mesh_6)  # disabled

number_slider_29 = Slider(1, range=0..1)
subdmesh = SubDFromMesh(Mesh=qrmesh, Creases=1, Corners=1, Interpolate=False)  # disabled
# Amount of points
number_slider_30 = Slider(300, range=0..3000)
number_slider_31 = Slider(150, range=0..3000)  # disabled
rectangle_2 = Rectangle(Plane=PlaneXY(0, 0, 0), XSize=domcen_2, YSize=domcen_2, Radius=0)  # -> Rectangle, Length; disabled
domcen_3 = CenteredDomain(DomainSize=number_slider_25)  # disabled
number_slider_32 = Slider(0.015, range=0..1)
sunion = SolidUnion(Breps=pipeline)
mesh_8 = MeshBrep(Brep=subdmesh, Settings=custom_mesh_settings)  # disabled
panel_6 = Panel("3000")  # disabled
number_slider_33 = Slider(1, range=0..1)  # disabled
rectangle_3 = Rectangle(Plane=PlaneXY(0, 0, 0), XSize=domcen_3, YSize=domcen_3, Radius=0)  # -> Rectangle, Length; disabled
panel_7 = Panel("30")  # disabled
Z_5 = UnitZ(Factor="3000")
panel_8 = Panel("1000")
cr_pt = Cluster(C=filter, F=number_slider_30, N="10")
center_2 = Center(Geometric=rectangle_2.Rectangle)  # -> Center, Dimension
pt_6 = Point(Point(-41.37337807, 105.9055711, 422.3603123))

neg_2 = Negative(Value=Slider(1, range=0..1))
offmsh = OffsetMesh(Mesh=mesh_6, Distance=neg_2, BothSides=0, CreateSolid=True)
previewmat = CustomPreviewMaterials(Geometry=offmsh, DiffuseColor=ColourSwatch(SwatchColor=RGB(0, 0, 0)), Transparency=Slider(0.41, range=0..1))

mesh_9 = MeshBrep(
    Brep=sunion,
    Settings={GridMaxCount=0, GridMinCount=16, JaggedSeams=False, MaxEdgeLength=0, MinEdgeLength=0.0001, MinTolerance=0, Refine=True, RefineAngle=0, RelativeTolerance=0.65, SimplePlanes=True, Tolerance=0})
Z_6 = UnitZ(Factor=Slider(4200, range=0..10000))
gpt = GPt(G=mesh_8, F=number_slider_31, N=panel_7)  # disabled
move_5 = Move(Geometry=rectangle_2.Rectangle, Motion=Z_5)  # -> Geometry, Transform
Z_7 = UnitZ(Factor=panel_6)  # disabled
qrsettings = QuadRemeshSettings(
    TargetCount="200",
    AdaptiveSize=0,
    AdaptiveCount=Toggle(False),
    HardEdges=Toggle(True),
    SeamEdges=0,
    Symmetry=0,
    GuideCurves=0)
move_6 = Move(Geometry=center_2.Center, Motion=Z_6)  # -> Geometry, Transform
number_slider_34 = Slider(50, range=0..100)
# Gravity
pt_7 = Point(cr_pt)
neg_3 = Negative(Value=number_slider_33)  # disabled
number_slider_35 = Slider(47, range=0..100)
move_7 = Move(Geometry=rectangle_3.Rectangle, Motion=Z_7)  # -> Geometry, Transform; disabled
number_slider_36 = Slider(0.45, range=0..1)  # disabled
boundary_5 = BoundarySurfaces(Edges=move_5.Geometry)
# On/Off
number_slider_37 = Slider(20, range=0..20)
qrmesh_2 = QuadRemesh(Mesh=mesh_9, Settings=qrsettings)
offmsh_2 = OffsetMesh(Mesh=mesh_8, Distance=neg_3, BothSides=0, CreateSolid=True)  # disabled
panel_9 = Panel("""0
2
43""")
panel_10 = Panel("""34
56
5""")
panel_11 = Panel("""6
78
890""")
Z_8 = UnitZ(Factor=1)
swatch = ColourSwatch(SwatchColor=RGB(8, 0, 255))
swatch_2 = ColourSwatch(SwatchColor=RGB(255, 238, 0))
solver = ValueList({"ByGravity", "ByDirect"}, selected="ByDirect")
number_slider_38 = Slider(0.623, range=0..1)  # disabled
number_slider_39 = Slider(40, range=0..100)
boundary_6 = BoundarySurfaces(Edges=move_7.Geometry)
swatch_3 = ColourSwatch(SwatchColor=RGB(0, 0, 0))  # disabled
pt_8 = Point(Point(-41.37337807, 105.9055711, 422.3603123))
pt_9 = Point(Point(-41.37337807, 105.9055711, 422.3603123))
pt_10 = Point(popgeo_2)
vec_6 = Vector(vec2pt_2.Vector)
panel_12 = Panel("""45
7878
42356""")
msphere = MeshSphere(Base=move_6.Geometry, Radius=Slider(250, range=0..600), UCount=number_slider_34, VCount=number_slider_34)
subdmesh_2 = SubDFromMesh(Mesh=qrmesh_2, Creases=1, Corners=1, Interpolate=False)
cluster_5 = Cluster_2(geo=boundary_5, N=Slider(10, range=0..10), S=panel_9, t=number_slider_29)

# ----
# Specify the path to the file:
# ...\PathSolver\PathSolver_PY\PathSolver.py"
read_file = ReadFile(
    File="F:\Мой диск\Work\2022_02_ART\20220918_PathSolver\GIT_Path\PathSolver\PathSolver_PY\PathSolver.py",
    PerLineParse=False)

cluster_6 = Cluster_2(geo=boundary_5, N=Slider(37, range=0..40), S=panel_10, t=number_slider_29)
cluster_7 = Cluster_2(geo=boundary_5, N=Slider(6, range=0..40), S=panel_11, t=number_slider_29)
rev_2 = Reverse(Vector=Z_8)
panel_13 = Panel("""0
2
43""")
panel_14 = Panel("""6
78
890""")
panel_15 = Panel("""34
56
5""")
dir = Dir(P=pt_9, t=Slider(0.623, range=0..1))
dir_2 = Dir(P=pt_8, t=Slider(0.623, range=0..1))
pt_11 = Point(pt_10)
vec_7 = Vector(vec_6)
mesh_10 = Mesh(mesh)

toggle_3 = GroupToggle(ToggleActive=True, ToggleVisible=False)  # disabled
neg_4 = Negative(Value=Slider(1, range=0..1))
offmsh_3 = OffsetMesh(Mesh=mesh_10, Distance=neg_4, BothSides=0, CreateSolid=True)
previewmat_2 = CustomPreviewMaterials(Geometry=offmsh_3, DiffuseColor=ColourSwatch(SwatchColor=RGB(0, 0, 0)), Transparency=Slider(0.51, range=0..1))

pt_12 = Point(Point(-41.37337807, 105.9055711, 422.3603123))  # disabled
previewmat_3 = CustomPreviewMaterials(Geometry=offmsh_2, DiffuseColor=swatch_3, Transparency=number_slider_36)  # disabled
mesh_uv_2 = MeshSurface(Surface=boundary_5, UCount=number_slider_35, VCount=number_slider_35, Overhang=True, Equalize=False)
brep_3 = Brep(subdmesh_2)
mcol = MeshColours(Mesh=msphere, Colours=swatch_2)
cluster_8 = Cluster_2(geo=boundary_6, N=Slider(6, range=0..10), S=panel_13, t=number_slider_32)
cluster_9 = Cluster_2(geo=boundary_6, N=Slider(40, range=0..40), S=panel_15, t=number_slider_32)
cluster_10 = Cluster_2(geo=boundary_6, N=Slider(6, range=0..40), S=panel_14, t=number_slider_32)
cluster_11 = Cluster_2(geo=boundary_6, N=Slider(90, range=0..90), S=panel_12, t=number_slider_32)
pathsolver = GhPythonScript(
    Code=read_file,
    SOLVER=solver,
    START_POINT_LIST=pt_7,
    MESH=filter,
    START_VEC_PROJ=rev_2,
    MOVE_DIST=Slider(1.2, range=0..20),
    N_STEP=Slider(100000, range=0..200000),
    MIN_RAY_DIST=Slider(0, range=0..20),
    MAX_RAY_DIST=number_slider_37,
    RUN=Toggle(True))  # -> Out, simplify(WayPoints), simplify(WayOutsidePoints), simplify(WayNormal)
dir_3 = Dir(P=pt_12, t=number_slider_38)  # disabled
mesh_11 = MeshBrep(
    Brep=brep_3,
    Settings={GridMaxCount=0, GridMinCount=16, JaggedSeams=False, MaxEdgeLength=0, MinEdgeLength=0.0001, MinTolerance=0, Refine=True, RefineAngle=0, RelativeTolerance=0.65, SimplePlanes=True, Tolerance=0})
mesh_uv_3 = MeshSurface(Surface=boundary_6, UCount=number_slider_39, VCount=number_slider_39, Overhang=True, Equalize=False)
demesh_2 = DeconstructMesh(Mesh=mesh_uv_2)  # -> Vertices, Faces, Colours, Normals
neg_5 = Negative(Value=Slider(4, range=0..10))
cluster_12 = Cluster(C=boundary_5, F=Slider(1630, range=0..3000), N="1800")
pdecon_2 = Deconstruct(Point=demesh_2.Vertices)  # -> XComponent, YComponent, ZComponent
offmsh_4 = OffsetMesh(Mesh=mesh_11, Distance=neg_5, BothSides=0, CreateSolid=invert(True))
demesh_3 = DeconstructMesh(Mesh=mesh_uv_3)  # -> Vertices, Faces, Colours, Normals
Z_9 = UnitZ(Factor=1)
cp_5 = ClosestPoint(Point=demesh_2.Vertices, Cloud=cluster_7)  # -> ClosestPoint, CPIndex, Distance
neg_6 = Negative(Value=pdecon_2.XComponent)
pdecon_3 = Deconstruct(Point=demesh_3.Vertices)  # -> XComponent, YComponent, ZComponent
cp_6 = ClosestPoint(Point=demesh_2.Vertices, Cloud=cluster_6)  # -> ClosestPoint, CPIndex, Distance
cp_7 = ClosestPoint(Point=demesh_2.Vertices, Cloud=cluster_5)  # -> ClosestPoint, CPIndex, Distance
Z_10 = UnitZ(Factor=1)
solver_2 = ValueList({"ByGravity", "ByDirect"}, selected="ByDirect")
cp_8 = ClosestPoint(Point=demesh_3.Vertices, Cloud=cluster_8)  # -> ClosestPoint, CPIndex, Distance
cp_9 = ClosestPoint(Point=demesh_3.Vertices, Cloud=cluster_9)  # -> ClosestPoint, CPIndex, Distance
cp_10 = ClosestPoint(Point=demesh_3.Vertices, Cloud=cluster_10)  # -> ClosestPoint, CPIndex, Distance
cp_11 = ClosestPoint(Point=demesh_3.Vertices, Cloud=cluster_11)  # -> ClosestPoint, CPIndex, Distance
solver_3 = ValueList({"ByGravity", "ByDirect"}, selected="ByDirect")
Z_11 = UnitZ(Factor=1)
Z_12 = UnitZ(Factor=1)
solver_4 = ValueList({"ByGravity", "ByDirect"}, selected="ByDirect")
solver_5 = ValueList({"ByGravity", "ByDirect"}, selected="ByDirect")
rev_3 = Reverse(Vector=Z_9)
Z_13 = UnitZ(Factor=1)
mcol_2 = MeshColours(Mesh=offmsh_4, Colours=ColourSwatch(SwatchColor=RGB(0, 0, 0)))
neg_7 = Negative(Value=pdecon_3.YComponent)
rev_4 = Reverse(Vector=Z_10)
read_file_2 = ReadFile(
    File="F:\Мой диск\Work\2022_02_ART\20220918_PathSolver\GIT_Path\PathSolver\PathSolver_PY\PathSolver.py",
    PerLineParse=False)  # "V0.03"
pt_13 = Point(pathsolver.WayPoints)
read_file_3 = ReadFile(
    File="F:\Мой диск\Work\2019_1_Grasshopper_Video_Lessons\-L#44_ComeDownTheMountain\Rhino\ComeDownTheMountain_PY\ComeDownTheMountain_v0.03.py",
    PerLineParse=False)  # "V0.03"
rev_5 = Reverse(Vector=Z_11)
read_file_4 = ReadFile(
    File="F:\Мой диск\Work\2022_02_ART\20220918_PathSolver\GIT_Path\PathSolver\PathSolver_PY\PathSolver.py",
    PerLineParse=False)  # "V0.03"
rev_6 = Reverse(Vector=Z_12)
read_file_5 = ReadFile(
    File="F:\Мой диск\Work\2022_02_ART\20220918_PathSolver\GIT_Path\PathSolver\PathSolver_PY\PathSolver.py",
    PerLineParse=False)  # "V0.03"
meshray = MeshRay(Mesh=msphere, Point=cluster_12, Direction=rev_3)  # -> Point, Hit
python_2 = GhPythonScript(
    Code=read_file_2,
    SOLVER=solver_2,
    START_POINT_LIST=pt_12,
    MESH=mesh_8,
    START_VEC_PROJ=rev_4,
    START_VEC_DIR=dir_3,
    MOVE_DIST=Slider(1.5, range=0..20),
    N_STEP=Slider(14011, range=0..200000),
    MIN_RAY_DIST=Slider(0, range=0..20),
    MAX_RAY_DIST=Slider(20, range=0..20),
    RUN=Toggle(True))  # -> Out, simplify(WayPoints), simplify(WayOutsidePoints), simplify(WayNormal)
pathsolver_2 = GhPythonScript(
    Code=read_file_3,
    SOLVER=solver_3,
    START_POINT_LIST=pt_3,
    MESH=mesh_10,
    START_VEC_PROJ=Z_13,
    START_VEC_DIR=vec_4,
    MOVE_DIST=Slider(1.2, range=0..20),
    N_STEP=Slider(30000, range=0..200000),
    MIN_RAY_DIST=Slider(0, range=0..20),
    MAX_RAY_DIST=Slider(20, range=0..20),
    RUN=Toggle(True))  # -> Out, simplify(WayPoints), simplify(WayOutsidePoints), simplify(WayNormal)
pathsolver_3 = GhPythonScript(
    Code=read_file_4,
    SOLVER=solver_4,
    START_POINT_LIST=pt_5,
    MESH=mesh_7,
    START_VEC_PROJ=rev_5,
    START_VEC_DIR=vec_5,
    MOVE_DIST=Slider(1.2, range=0..20),
    N_STEP=Slider(100000, range=0..200000),
    MIN_RAY_DIST=Slider(0, range=0..20),
    MAX_RAY_DIST=Slider(20, range=0..20),
    RUN=Toggle(True))  # -> Out, simplify(WayPoints), simplify(WayOutsidePoints), simplify(WayNormal)
pathsolver_4 = GhPythonScript(
    Code=read_file_5,
    SOLVER=solver_5,
    START_POINT_LIST=pt_11,
    MESH=mesh_10,
    START_VEC_PROJ=rev_6,
    START_VEC_DIR=vec_7,
    MOVE_DIST=Slider(1.2, range=0..20),
    N_STEP=Slider(30000, range=0..200000),
    MIN_RAY_DIST=Slider(0, range=0..20),
    MAX_RAY_DIST=Slider(20, range=0..20),
    RUN=Toggle(True))  # -> Out, simplify(WayPoints), simplify(WayOutsidePoints), simplify(WayNormal)
clean = CleanTree(RemoveNulls=True, RemoveInvalid=True, RemoveEmpty=invert(False), Tree=pt_13)
multiplication_8 = Multiplication(A=cp_7.Distance, B=Slider(0.15, range=0..1))
multiplication_9 = Multiplication(A=cp_6.Distance, B=Slider(0.23, range=0..1))
multiplication_10 = Multiplication(A=cp_5.Distance, B=Slider(0.7, range=0..1))
multiplication_11 = Multiplication(A=neg_6, B=Slider(0.43, range=0..1))
cull = CullPattern(List=cluster_12, CullPattern=invert(meshray.Hit))
cull_2 = CullPattern(List=cluster_12, CullPattern=meshray.Hit)
pline = PolyLine(Vertices=clean, Closed=False)
cluster_13 = Cluster(C=sunion, F=Slider(941, range=0..3000), N="4000")
multiplication_12 = Multiplication(A=cp_10.Distance, B=Slider(0.3, range=0..1))
multiplication_13 = Multiplication(A=cp_11.Distance, B=Slider(0.07, range=0..1))
multiplication_14 = Multiplication(A=cp_8.Distance, B=Slider(0.17, range=0..1))
multiplication_15 = Multiplication(A=cp_9.Distance, B=Slider(0.2, range=0..1))  # disabled
multiplication_16 = Multiplication(A=neg_7, B=Slider(0.14, range=0..1))
addition_4 = Addition(A=multiplication_8, B=multiplication_9, C=multiplication_10, D=multiplication_11)
addition_5 = Addition(A=multiplication_16, B=Slider(43, range=0..1000))
pt_14 = Point(pathsolver_2.WayPoints)
vec_8 = Vector(pathsolver_2.WayNormal)
pt_15 = Point(pathsolver_2.WayOutsidePoints)

graph = GraphMapper(
    Slider(1, range=1e-06..1),
    x0=0,
    x1=1,
    y0=0,
    y1=1,
    container_name="Bezier",
    cpx=[0, 0.5225044489, 0.8455407023, 1],
    cpy=[0, 0.1260257959, 0.4517461658, 1])
crv_3 = Curve(reparameterize(simplify(pline)))
shatter = Shatter(Curve=crv_3, Parameters=graph)
item = ListItem(List=shatter, Index=0, Wrap=True)
previewlw = CustomPreviewLineweights(Geometry=item, Shader=ColourSwatch(SwatchColor=RGB(0, 0, 0)), Absolute=False)

pt_16 = Point(flatten(cluster_13))
Z_14 = UnitZ(Factor=Slider(430, range=0..1000))
pt_17 = Point(python_2.WayPoints)
pt_18 = Point(python_2.WayOutsidePoints)
vec_9 = Vector(python_2.WayNormal)
pt_19 = Point(pathsolver_4.WayPoints)
pt_20 = Point(pathsolver_4.WayOutsidePoints)
vec_10 = Vector(pathsolver_4.WayNormal)
mesh_12 = Mesh(mesh_11)

Z_15 = UnitZ(Factor=1)
rev_7 = Reverse(Vector=Z_15)
meshray_2 = MeshRay(Mesh=mesh_12, Point=cluster_13, Direction=rev_7)  # -> Point, Hit
msphere_2 = MeshSphere(Base=meshray_2.Point, Radius=Slider(1, range=0..1), UCount="9", VCount="9")
previewmat_4 = CustomPreviewMaterials(Geometry=msphere_2, DiffuseColor=ColourSwatch(SwatchColor=RGB(255, 255, 255)))

pt_21 = Point(pathsolver_3.WayPoints)
pt_22 = Point(pathsolver_3.WayOutsidePoints)
vec_11 = Vector(pathsolver_3.WayNormal)
item_2 = ListItem(List=pt_17, Index=0, Wrap=True)
swatch_4 = ColourSwatch(SwatchColor=RGB(255, 0, 0))
msphere_3 = MeshSphere(Base=item_2, Radius=Slider(10, range=0..10), UCount=10, VCount=20)
move_8 = Move(Geometry=item_2, Motion=Z_14)  # -> Geometry, Transform
pline_2 = PolyLine(Vertices=pt_14, Closed=False)
pline_3 = PolyLine(Vertices=pt_21, Closed=False)
addition_6 = Addition(A=multiplication_14, B=multiplication_15, C=multiplication_12, D=multiplication_13, E=addition_5)
pline_4 = PolyLine(Vertices=pt_19, Closed=False)
pline_5 = PolyLine(Vertices=pt_17, Closed=False)
mcol_3 = MeshColours(Mesh=msphere_3, Colours=ColourSwatch(SwatchColor=RGB(255, 255, 255)))
python_3 = GhPythonScript(START_POINT_LIST=pt_16, MESH=mesh_12, MOVE_DIST=Slider(5, range=0..20), N_STEP=Slider(200, range=0..200))  # -> out, simplify(wayPoints), wayOutsidePoints; inputs START_POINT_LIST: list of Point3d, MESH: Mesh, N_STEP: Int32
# ---------- python_3: Python ----------
__author__ = "AndriiPavlov"
__version__ = "2022.09.14"

# V0.02

import Rhino.Geometry as rg
import Rhino.UI as ui
import rhinoscriptsyntax as rs
import ghpythonlib.components as gh
import ghpythonlib.treehelpers as th
import math as ma
#import Rhino as r
#import copy
#import time
#import System
#import os


class Solver():

    def __init__(self):
        self.directVectro = rg.Vector3d(0,0,-1)
        self.moveDist = MOVE_DIST
        self.mesh = MESH
        self.wayPointsList = []
        self.wayOutsidePoints = []

    def GetWayPointList(self):
        return self.wayPointsList

    def GetWayOutsidePoints(self):
        return self.wayOutsidePoints

    def StepOne(self, point):
        ray = rg.Intersect.Intersection.MeshRay(self.mesh, rg.Ray3d(point, self.directVectro))
        rayPoint = rg.Point3d(point.X + self.directVectro.X * ray,
                              point.Y + self.directVectro.Y * ray,
                              point.Z + self.directVectro.Z * ray
                              )
        if ray < 0:
            if self.wayPointsList:
                self.wayOutsidePoints.append(self.wayPointsList[-1])
            return None

        self.wayPointsList.append(rayPoint)

        meshPoint = self.mesh.ClosestMeshPoint(rayPoint, 100000.0)
        normal = self.mesh.NormalAt(meshPoint)
        normal.Unitize()

        ptMoveBNormal = rg.Point3d(rayPoint.X + normal.X * self.moveDist,
                                   rayPoint.Y + normal.Y * self.moveDist,
                                   rayPoint.Z + normal.Z * self.moveDist
                                   )
        return ptMoveBNormal

    def SolverForMultiplePoints(self, startPt, nStep):

        tempPt = startPt
        for i in range(nStep):
            if tempPt:
                tempPt = self.StepOne(tempPt)
            else:
                break


wayPoints = []
wayOutsidePoints = []
for p in START_POINT_LIST:
    solver = Solver()
    solver.SolverForMultiplePoints(p, N_STEP)
    wayPoints.append(solver.GetWayPointList())
    wayOutsidePoints.append(solver.GetWayOutsidePoints())

wayPoints = th.list_to_tree(wayPoints)
wayOutsidePoints = th.list_to_tree(wayOutsidePoints)
# ---------- end python_3 ----------
number_slider_40 = Slider(0.35652807, range=0..1)  # disabled
multiplication_17 = Multiplication(A=addition_4, B=Slider(0.56, range=0..1))
Z_16 = UnitZ(Factor=multiplication_17)
move_9 = Move(Geometry=demesh_2.Vertices, Motion=Z_16)  # -> Geometry, Transform
conmesh_2 = ConstructMesh(Vertices=move_9.Geometry, Faces=demesh_2.Faces)
merge = Merge(Data1=move_8.Geometry, Data2=pt_17)
crv_4 = Curve(reparameterize(simplify(pline_2)))
subdmesh_3 = SubDFromMesh(Mesh=conmesh_2, Creases=1, Corners=2, Interpolate=False)
multiplication_18 = Multiplication(A=addition_6, B=Slider(0.43, range=0..1))
rgb = ColourRGB(Alpha=255, Red=multiplication_18, Green=multiplication_18, Blue=multiplication_18)
mcol_4 = MeshColours(Mesh=mesh_uv_3, Colours=rgb)
mblur = BlurMesh(Mesh=mcol_4, Iterations=Slider(58, range=0..100))
demesh_4 = DeconstructMesh(Mesh=mblur)  # -> Vertices, Faces, Colours, Normals
argb = SplitARGB(Colour=demesh_4.Colours)  # -> Alpha, Red, Green, Blue
Z_17 = UnitZ(Factor=multiplication_18)
brep_4 = Brep(subdmesh_3)

Z_18 = UnitZ(Factor="-0.5")
swatch_5 = ColourSwatch(SwatchColor=RGB(18, 18, 18))
move_10 = Move(Geometry=brep_4, Motion=Z_18)  # -> Geometry, Transform
edges = BrepEdges(Brep=move_10.Geometry)  # -> Naked, Interior, NonManifold
previewlw_2 = CustomPreviewLineweights(Geometry=edges.Interior, Shader=swatch_5, Absolute=False)
crv_5 = Curve(edges.Naked)
previewlw_3 = CustomPreviewLineweights(Geometry=crv_5, Shader=swatch_5, Absolute=False)
project = Project(Geometry=crv_5, Plane=PlaneXY(0, 0, 0))  # -> Geometry, Transform
rulesrf = RuledSurface(CurveA=crv_5, CurveB=project.Geometry)
planar = IsPlanar(Surface=rulesrf, Interior=True)  # -> Planar, Plane
deplane = DeconstructPlane(Plane=planar.Plane)  # -> Origin, XAxis, YAxis, ZAxis
X = UnitX(Factor=1)
Y = UnitY(Factor=1)
dprod = DotProduct(VectorA=deplane.ZAxis, VectorB=Y, Unitize=invert(False))
dprod_2 = DotProduct(VectorA=deplane.ZAxis, VectorB=X, Unitize=invert(False))
amp_3 = Amplitude(Vector=deplane.ZAxis, Amplitude=Slider(100, range=0..100))
rev_8 = Reverse(Vector=amp_3)
equals = Equality(FirstNumber=dprod, SecondNumber="1")  # -> Equality, Inequality
equals_2 = Equality(FirstNumber=dprod_2, SecondNumber="1")  # -> Equality, Inequality
vdis = VectorDisplay(Anchor=deplane.Origin, Vector=rev_8)  # disabled
nor = GateNor(A=equals_2.Equality, B=equals.Equality)
cull_3 = CullPattern(List=rulesrf, CullPattern=nor)
edges_2 = BrepEdges(Brep=cull_3)  # -> Naked, Interior, NonManifold
previewlw_4 = CustomPreviewLineweights(Geometry=edges_2.Naked, Shader=swatch_5, Absolute=False)

multiplication_19 = Multiplication(A=argb.Red, B=Slider(596, range=0..1000))
pt_23 = Point(python_3.wayPoints)
lng = ListLength(List=pt_17)  # disabled
move_11 = Move(Geometry=demesh_3.Vertices, Motion=Z_17)  # -> Geometry, Transform
Z_19 = UnitZ(Factor=multiplication_19)
mesh_13 = MeshBrep(
    Brep=brep_4,
    Settings={GridMaxCount=0, GridMinCount=16, JaggedSeams=False, MaxEdgeLength=0, MinEdgeLength=0.0001, MinTolerance=0, Refine=True, RefineAngle=0, RelativeTolerance=0.65, SimplePlanes=True, Tolerance=0})

toggle_4 = GroupToggle(ToggleActive=True, ToggleVisible=False)  # disabled
pt_24 = Point(flatten(cull))
pt_25 = Point(flatten(cull_2))
mesh_14 = Mesh(mesh_13)
mesh_15 = Mesh(mesh_13)

pline_6 = PolyLine(Vertices=pt_23, Closed=False)
remap = RemapNumbers(Value=number_slider_40, Source=Domain(0, 1), Target=lng)  # -> Mapped, Clipped; disabled
move_12 = Move(Geometry=demesh_4.Vertices, Motion=Z_19)  # -> Geometry, Transform
crv_6 = Curve(reparameterize(simplify(pline_6)))
int = Integer(remap.Mapped)
cluster_14 = Cluster(C=boundary_6, F=Slider(1630, range=0..3000), N="3000")
conmesh_3 = ConstructMesh(Vertices=move_12.Geometry, Faces=demesh_4.Faces)
conmesh_4 = ConstructMesh(Vertices=move_11.Geometry, Faces=demesh_3.Faces)
python_4 = GhPythonScript(START_POINT_LIST=pt_25, MESH=mesh_14, MOVE_DIST=Slider(5, range=0..20), N_STEP=Slider(200, range=0..200))  # -> out, simplify(wayPoints), wayOutsidePoints; inputs START_POINT_LIST: list of Point3d, MESH: Mesh, N_STEP: Int32; same code as python_3
python_5 = GhPythonScript(START_POINT_LIST=pt_24, MESH=mesh_15, MOVE_DIST=Slider(5, range=0..20), N_STEP=Slider(200, range=0..200))  # -> out, simplify(wayPoints), wayOutsidePoints; inputs START_POINT_LIST: list of Point3d, MESH: Mesh, N_STEP: Int32; same code as python_3
split = SplitList(List=vec_9, Index=int)  # -> ListA, ListB
split_2 = SplitList(List=pt_17, Index=int)  # -> ListA, ListB

number_slider_41 = Slider(1, range=1e-06..1)
graph_2 = GraphMapper(
    number_slider_41,
    x0=0,
    x1=1,
    y0=0,
    y1=1,
    container_name="Bezier",
    cpx=[0, 0, 0.2392344624, 1],
    cpy=[0, 0.7653586864, 1, 1])
graph_3 = GraphMapper(
    number_slider_41,
    x0=0,
    x1=1,
    y0=0,
    y1=1,
    container_name="Bezier",
    cpx=[0, 0.6539455056, 0.9452477694, 1],
    cpy=[0, 0, 0.3964899182, 1])
flip = FlipCurve(Curve=crv_6)  # -> reparameterize(Curve), Flag
shatter_2 = Shatter(Curve=crv_6, Parameters=graph_3)
panel_16 = Panel("-1")
swatch_6 = ColourSwatch(SwatchColor=RGB(0, 0, 0))
item_3 = ListItem(List=shatter_2, Index=0, Wrap=True)
previewlw_5 = CustomPreviewLineweights(Geometry=item_3, Shader=ColourSwatch(SwatchColor=RGB(255, 255, 255)), Absolute=False)

number_slider_42 = Slider(15, range=0..100)
pt_26 = Point(split_2.ListA)  # disabled
filter_2 = StreamFilter(Gate=Toggle(False), Stream0=conmesh_3, Stream1=conmesh_4)
pt_27 = Point(simplify(graft(split_2.ListA)))
vec_12 = Vector(simplify(graft(split.ListA)))
swatch_7 = ColourSwatch(SwatchColor=RGB(255, 0, 0))
swatch_8 = ColourSwatch(SwatchColor=RGB(46, 0, 0))
pt_28 = Point(flatten(cluster_14))
mesh_16 = Mesh(filter_2)
item_4 = ListItem(List=python_4.wayPoints, Index=0, Wrap=True)

subdmesh_4 = SubDFromMesh(Mesh=mesh_16, Creases=1, Corners=2, Interpolate=False)  # disabled
toggle_5 = GroupToggle(ToggleActive=True, ToggleVisible=False)  # disabled
brep_5 = Brep(subdmesh_4)  # disabled
mesh_17 = MeshBrep(
    Brep=brep_5,
    Settings={GridMaxCount=0, GridMinCount=16, JaggedSeams=False, MaxEdgeLength=0, MinEdgeLength=0.0001, MinTolerance=0, Refine=True, RefineAngle=0, RelativeTolerance=0.65, SimplePlanes=True, Tolerance=0})  # disabled

range = Range(Domain=Domain(0, 1), Steps=Slider(10, range=0..10))
pt_29 = Point(python_4.wayPoints)
swatch_9 = ColourSwatch(SwatchColor=RGB(0, 162, 255))
swatch_10 = ColourSwatch(SwatchColor=RGB(255, 212, 0))
pt_30 = Point(python_5.wayPoints)
graft = GraftTree(Tree=ColourSwatch(SwatchColor=RGB(255, 255, 255)), IncludeEmptyLists=True, IncludeNullItems=True)  # -> simplify(Tree)
graft_2 = GraftTree(Tree=ColourSwatch(SwatchColor=RGB(255, 255, 255)), IncludeEmptyLists=True, IncludeNullItems=True)  # -> simplify(Tree)
pline_7 = PolyLine(Vertices=pt_29, Closed=False)
pline_8 = PolyLine(Vertices=pt_30, Closed=False)
msphere_4 = MeshSphere(Base=item_4, Radius=Slider(3, range=0..7), UCount="15", VCount="15")
multiplication_20 = Multiplication(A=range, B=Slider(45, range=0..100))
col = Colour(ColourSwatch(SwatchColor=RGB(255, 255, 255)))

number_slider_43 = Slider(1, range=0..1)
crv_7 = Curve(reparameterize(simplify(pline_3)))
graph_4 = GraphMapper(
    number_slider_43,
    x0=0,
    x1=1,
    y0=0,
    y1=1,
    container_name="Bezier",
    cpx=[0, 0.6323337555, 0.7658383846, 1],
    cpy=[0, 0, 0.4537242651, 1])
shatter_3 = Shatter(Curve=crv_7, Parameters=graph_4)
item_5 = ListItem(List=shatter_3, Index=0, Wrap=True)
previewlw_6 = CustomPreviewLineweights(Geometry=item_5, Shader=col, Thickness="1", Absolute=False)

pt_31 = Point(pt_4)
Z_20 = UnitZ(Factor=Slider(1111, range=0..2000))
rev_9 = Reverse(Vector=Z_20)
move_13 = Move(Geometry=pt_31, Motion=rev_9)  # -> Geometry, Transform
cir_4 = Circle(Plane=move_13.Geometry, Radius=Slider(8653, range=0..18000))
crv_8 = Curve(reparameterize(simplify(cir_4)))
eval = EvaluateCurve(Curve=crv_8, Parameter=number_slider_43)  # -> Point, Tangent, Angle
camera = CameraCrane(
    Location=eval.Point,
    Target=move_13.Geometry,
    Lense=Slider(100, range=0..100),
    Perspective=Slider(1, range=0..1),
    Refresh=True)  # -> Camera, Target, Lens, Up, HorizontalViewAngle, VerticalViewAngle, ScreenRatio, Frame

tstat = TreeStatistics(Tree=crv_7)  # -> Paths, Length, Count
subtraction = Subtraction(A=number_slider_43, B=Slider(1, range=0..1))
range_2 = Range(Domain=Domain(0, 1), Steps=tstat.Count)
abs = Absolute(Value=subtraction)
gradient = Gradient(LowerLimit=0, UpperLimit=1, Parameter=range_2, stops=[0: RGB(255, 255, 255), 1: RGB(0, 0, 0)])
gradient_2 = Gradient(LowerLimit=0, UpperLimit=1, Parameter=range_2, stops=[0.15: RGB(255, 130, 160), 0.85: RGB(220, 0, 40)])
gradient_3 = Gradient(LowerLimit=0, UpperLimit=1, Parameter=range_2, stops=[0: RGB(0, 51, 255), 1: RGB(255, 217, 0)])
randcol = RandomColor(Data=tstat.Paths, Seed=2, FastMode=False)
graft_3 = GraftTree(Tree=gradient_2, IncludeEmptyLists=True, IncludeNullItems=True)  # -> simplify(Tree)
graft_4 = GraftTree(Tree=randcol, IncludeEmptyLists=True, IncludeNullItems=True)  # -> simplify(Tree)
col_2 = Colour(graft_3)
panel_17 = Panel(col_2)
amp_4 = Amplitude(Vector=vec_12, Amplitude=multiplication_20)
previewlw_7 = CustomPreviewLineweights(Geometry=pline_8, Shader=ColourSwatch(SwatchColor=RGB(255, 255, 255)), Absolute=False)
gradient_4 = Gradient(LowerLimit=0, UpperLimit=1, Parameter=range, stops=[0: RGB(255, 255, 255), 1: RGB(0, 0, 0)])
end_2 = EndPoints(Curve=item_5)  # -> Start, End
mcol_5 = MeshColours(Mesh=msphere_4, Colours=swatch_2)

crv_9 = Curve(reparameterize(simplify(pline_5)))  # disabled
number_slider_44 = Slider(0.434523, range=0..1)
graph_5 = GraphMapper(
    number_slider_44,
    x0=0,
    x1=1,
    y0=0,
    y1=1,
    container_name="Bezier",
    cpx=[0, 0.6323337555, 0.7658383846, 1],
    cpy=[0, 0, 0.4537242651, 1])
graph_6 = GraphMapper(
    number_slider_44,
    x0=0,
    x1=1,
    y0=0,
    y1=1,
    container_name="Bezier",
    cpx=[0, 0.6539455056, 0.9452477694, 1],
    cpy=[0, 0, 0.3964899182, 1])
flip_2 = FlipCurve(Curve=crv_9)  # -> reparameterize(Curve), Flag
shatter_4 = Shatter(Curve=crv_9, Parameters=graph_5)
swatch_11 = ColourSwatch(SwatchColor=RGB(0, 0, 0))
item_6 = ListItem(List=shatter_4, Index=0, Wrap=True)
previewlw_8 = CustomPreviewLineweights(Geometry=item_6, Shader=ColourSwatch(SwatchColor=RGB(255, 255, 255)), Thickness="1", Absolute=False)

move_14 = Move(Geometry=pt_27, Motion=amp_4)  # -> Geometry, Transform
previewlw_9 = CustomPreviewLineweights(Geometry=pline_7, Shader=swatch_2, Absolute=False)
end_3 = EndPoints(Curve=item_6)  # -> Start, End
pt_32 = Point(end_2.Start)
pt_33 = Point(end_2.End)

pt_34 = Point(flatten(pt_28))
mesh_18 = Mesh(mesh_16)
toggle_6 = GroupToggle(ToggleActive=True, ToggleVisible=False)  # disabled

pt_35 = Point(end_3.End)
flip_3 = FlipMatrix(Data=move_14.Geometry)
pline_9 = PolyLine(Vertices=flip_3, Closed=False)  # -> simplify(Polyline)
graft_5 = GraftTree(Tree=gradient_4, IncludeEmptyLists=True, IncludeNullItems=True)
relay = Relay()  # disabled
crv_10 = Curve()  # disabled
number_slider_45 = Slider(19, range=0..30)  # disabled
dots = DotDisplay(Point=pt_33, Colour=col, Size=Slider(9.1, range=0..10))
python_6 = GhPythonScript(START_POINT_LIST=pt_34, MESH=mesh_18, MOVE_DIST=Slider(5, range=0..20), N_STEP=Slider(200, range=0..200))  # -> out, simplify(wayPoints), wayOutsidePoints; inputs START_POINT_LIST: list of Point3d, MESH: Mesh, N_STEP: Int32; same code as python_3
previewlw_10 = CustomPreviewLineweights(Geometry=pline_9, Shader=graft_5, Absolute=False)
end_4 = EndPoints(Curve=relay)  # -> Start, End; disabled
panel_19 = Panel("0")  # disabled

number_slider_46 = Slider(1, range=1e-06..1)
graph_7 = GraphMapper(
    number_slider_46,
    x0=0,
    x1=1,
    y0=0,
    y1=1,
    container_name="Bezier",
    cpx=[0, 0, 0.2392344624, 1],
    cpy=[0, 0.7653586864, 1, 1])
graph_8 = GraphMapper(
    number_slider_46,
    x0=0,
    x1=1,
    y0=0,
    y1=1,
    container_name="Bezier",
    cpx=[0, 0.6539455056, 0.9452477694, 1],
    cpy=[0, 0, 0.3964899182, 1])
flip_4 = FlipCurve(Curve=crv_10)  # -> reparameterize(Curve), Flag
shatter_5 = Shatter(Curve=crv_10, Parameters=graph_8)
swatch_12 = ColourSwatch(SwatchColor=RGB(0, 0, 0))
item_7 = ListItem(List=shatter_5, Index=0, Wrap=True)
previewlw_11 = CustomPreviewLineweights(Geometry=item_7, Shader=ColourSwatch(SwatchColor=RGB(255, 255, 255)), Absolute=False)

ext = ExtendCurve(Curve=relay, Type=0, Start=number_slider_45, End=panel_19)  # disabled
end_5 = EndPoints(Curve=ext)  # -> Start, End; disabled
pt_36 = Point(end_4.Start)  # disabled
pt_37 = Point(end_5.End)  # disabled
pt_38 = Point(python_6.wayPoints)
pline_10 = PolyLine(Vertices=pt_38, Closed=False)
camera_2 = CameraCrane(Location=pt_36, Target=pt_37, Lense=Slider(3, range=0..100), Perspective=Slider(1, range=0..1), Refresh=True)  # -> Camera, Target, Lens, Up, HorizontalViewAngle, VerticalViewAngle, ScreenRatio, Frame
swatch_13 = ColourSwatch(SwatchColor=RGB(255, 255, 255))
pcol = PolylineCollapse(Polyline=pline_10, Tolerance="1.00")  # -> Polyline, Count
previewlw_12 = CustomPreviewLineweights(Shader=ColourSwatch(SwatchColor=RGB(0, 0, 0)), Absolute=False)
explode = Explode(Curve=pcol.Polyline, Recursive=True)  # -> simplify(Segments), Vertices
lng_2 = ListLength(List=explode.Segments)
dom = ConstructDomain(DomainStart="1.00", DomainEnd="0.00")
range_3 = Range(Domain=Domain(0, 1), Steps=lng_2)
range_4 = Range(Domain=dom, Steps=lng_2)
multiplication_21 = Multiplication(A=range_4, B=Slider(6, range=0..10))
gradient_5 = Gradient(
    LowerLimit=0,
    UpperLimit=1,
    Parameter=range_3,
    stops=[0: RGB(0, 0, 0), 0.267: RGB(234, 38, 0), 0.582: RGB(60, 136, 250), 1: RGB(3, 87, 255)])
gradient_6 = Gradient(
    LowerLimit=0,
    UpperLimit=1,
    Parameter=range_3,
    stops=[0: RGB(0, 0, 0), 0.267: RGB(234, 38, 0), 0.582: RGB(255, 255, 255), 1: RGB(255, 255, 255)])
gradient_7 = Gradient(
    LowerLimit=0,
    UpperLimit=1,
    Parameter=range_3,
    stops=[0: RGB(243, 57, 0), 0.1: RGB(236, 27, 60), 0.2: RGB(210, 0, 118), 0.3: RGB(103, 0, 120), 0.4: RGB(39, 72, 161), 0.5: RGB(1, 192, 229), 0.6: RGB(18, 178, 90), 0.7: RGB(79, 186, 8), 0.8: RGB(220, 237, 32), 0.9: RGB(247, 159, 20), 1: RGB(243, 57, 0)])
gradient_8 = Gradient(
    LowerLimit=0,
    UpperLimit=1,
    Parameter=range_3,
    stops=[0.1: RGB(255, 255, 255), 0.2: RGB(0, 0, 0), 0.3: RGB(255, 255, 255), 0.4: RGB(0, 0, 0), 0.5: RGB(255, 255, 255), 0.6: RGB(0, 0, 0), 0.7: RGB(255, 255, 255), 0.8: RGB(0, 0, 0), 0.9: RGB(255, 255, 255)])
gradient_9 = Gradient(LowerLimit=0, UpperLimit=1, Parameter=range_3, stops=[0: RGB(255, 255, 255), 1: RGB(0, 0, 0)])
gradient_10 = Gradient(
    LowerLimit=0,
    UpperLimit=1,
    Parameter=range_3,
    stops=[0: RGB(234, 38, 0), 0.25: RGB(234, 126, 0), 0.5: RGB(254, 244, 84), 0.75: RGB(173, 203, 249), 1: RGB(75, 107, 169)])
gradient_11 = Gradient(
    LowerLimit=0,
    UpperLimit=1,
    Parameter=range_3,
    stops=[0: RGB(0, 0, 0), 0.239: RGB(234, 38, 0), 0.374: RGB(234, 126, 0), 0.733: RGB(96, 157, 247), 1: RGB(52, 105, 209)])
gradient_12 = Gradient(LowerLimit=0, UpperLimit=1, Parameter=range_3, stops=[0: RGB(0, 0, 0), 1: RGB(255, 255, 255)])
gradient_13 = Gradient(
    LowerLimit=0,
    UpperLimit=1,
    Parameter=range_3,
    stops=[0.0897: RGB(0, 0, 0), 0.298: RGB(234, 38, 0), 0.414: RGB(234, 126, 0), 0.635: RGB(96, 157, 247), 0.893: RGB(0, 0, 0)])
gradient_14 = Gradient(LowerLimit=0, UpperLimit=1, Parameter=range_3, stops=[0: RGB(0, 0, 0), 0.49: RGB(255, 255, 255), 1: RGB(0, 0, 0)])
gradient_15 = Gradient(
    LowerLimit=0,
    UpperLimit=1,
    Parameter=range_3,
    stops=[0: RGB(0, 0, 0), 0.206: RGB(27, 136, 245), 0.359: RGB(235, 215, 0), 0.582: RGB(255, 255, 255), 1: RGB(255, 255, 255)])
previewlw_13 = CustomPreviewLineweights(Geometry=explode.Segments, Shader=gradient_13, Absolute=False)
domcen_4 = CenteredDomain(DomainSize=Slider(481, range=0..1000))
box = CenterBox(Base=PlaneXY(0, 0, 0), X=domcen_4, Y=domcen_4, Z=domcen_4)
number_slider_47 = Slider(11, range=0..100)
crv_11 = Curve()  # disabled
scale = Scale(Geometry=box, Center=Point(0, 0, 0), Factor="2")  # -> Geometry, Transform
pop3d = Populate3D(Region=box, Count=number_slider_47, Seed=Slider(8, range=0..10))
pop3d_2 = Populate3D(Region=box, Count=number_slider_47, Seed=Slider(5, range=0..10))
pop3d_3 = Populate3D(Region=box, Count=number_slider_47, Seed=Slider(3, range=0..10))

number_slider_48 = Slider(1, range=1e-06..1)
graph_9 = GraphMapper(
    number_slider_48,
    x0=0,
    x1=1,
    y0=0,
    y1=1,
    container_name="Bezier",
    cpx=[0, 0, 0.2392344624, 1],
    cpy=[0, 0.7653586864, 1, 1])
graph_10 = GraphMapper(
    number_slider_48,
    x0=0,
    x1=1,
    y0=0,
    y1=1,
    container_name="Bezier",
    cpx=[0, 0.6539455056, 0.9452477694, 1],
    cpy=[0, 0, 0.3964899182, 1])
flip_5 = FlipCurve(Curve=crv_11)  # -> reparameterize(Curve), Flag
shatter_6 = Shatter(Curve=crv_11, Parameters=graph_10)
swatch_14 = ColourSwatch(SwatchColor=RGB(0, 0, 0))
item_8 = ListItem(List=shatter_6, Index=0, Wrap=True)
previewlw_14 = CustomPreviewLineweights(Geometry=item_8, Shader=ColourSwatch(SwatchColor=RGB(255, 255, 255)), Absolute=False)

pt_39 = Point(graft(pop3d))
pt_40 = Point(graft(pop3d_3))
pt_41 = Point(graft(pop3d_2))
intcrv = Interpolate(Vertices=[pt_39, pt_41, pt_40], Degree=3, Periodic=invert(False), KnotStyle=1)  # -> Curve, Length, Domain
eval_2 = EvaluateCurve(Curve=reparameterize(intcrv.Curve), Parameter=Slider(1, range=0..1))  # -> flatten(Point), Tangent, Angle
domcen_5 = CenteredDomain(DomainSize=Slider(285, range=0..1000))
box_2 = CenterBox(Base=eval_2.Point, X=domcen_5, Y=domcen_5, Z=domcen_5)
rotate = Rotate(Geometry=box_2, Angle=degrees("45"), Plane=eval_2.Point)  # -> Geometry, Transform
xz = XZPlane(Origin=eval_2.Point)
rotate_2 = Rotate(Geometry=rotate.Geometry, Angle=degrees("45"), Plane=xz)  # -> Geometry, Transform
mesh_19 = MeshBrep(
    Brep=rotate_2.Geometry,
    Settings={GridMaxCount=0, GridMinCount=16, JaggedSeams=False, MaxEdgeLength=0, MinEdgeLength=0.0001, MinTolerance=0, Refine=True, RefineAngle=0, RelativeTolerance=0.65, SimplePlanes=True, Tolerance=0})
mjoin = MeshJoin(Meshes=mesh_19)
rec = DataRecorder(DataLimit=-10, RecordData=True)  # disabled
vsettings = CreateSettings(VoxelSize="9", Bandwidth=1, Isovalue=0, Adaptivity=0.1)
vmesh = MeshToVolume(Mesh=mjoin, Settings=vsettings)

pt_42 = Point(center.Center)
Z_21 = UnitZ(Factor=Slider(0, range=0..2000))
rev_10 = Reverse(Vector=Z_21)
move_15 = Move(Geometry=pt_42, Motion=rev_10)  # -> Geometry, Transform
cir_5 = Circle(Plane=move_15.Geometry, Radius=Slider(12424, range=0..18000))
crv_12 = Curve(reparameterize(simplify(cir_5)))

number_slider_49 = Slider(1, range=0..1)
crv_13 = Curve(reparameterize(simplify(pline_4)))

tstat_2 = TreeStatistics(Tree=crv_13)  # -> Paths, Length, Count
subtraction_2 = Subtraction(A=number_slider_49, B=Slider(1, range=0..1))
range_5 = Range(Domain=Domain(0, 1), Steps=tstat_2.Count)
abs_2 = Absolute(Value=subtraction_2)
gradient_16 = Gradient(LowerLimit=0, UpperLimit=1, Parameter=range_5, stops=[0: RGB(255, 255, 255), 1: RGB(0, 0, 0)])
gradient_17 = Gradient(LowerLimit=0, UpperLimit=1, Parameter=range_5, stops=[0.15: RGB(255, 130, 160), 0.85: RGB(220, 0, 40)])
gradient_18 = Gradient(LowerLimit=0, UpperLimit=1, Parameter=range_5, stops=[0: RGB(0, 51, 255), 1: RGB(255, 217, 0)])

eval_3 = EvaluateCurve(Curve=crv_12, Parameter=number_slider_49)  # -> Point, Tangent, Angle
camera_3 = CameraCrane(
    Location=eval_3.Point,
    Target=move_15.Geometry,
    Lense=Slider(100, range=0..100),
    Perspective=Slider(1, range=0..1),
    Refresh=True)  # -> Camera, Target, Lens, Up, HorizontalViewAngle, VerticalViewAngle, ScreenRatio, Frame

graph_11 = GraphMapper(
    abs_2,
    x0=0,
    x1=1,
    y0=0,
    y1=1,
    container_name="Bezier",
    cpx=[0, 0.6323337555, 0.7658383846, 1],
    cpy=[0, 0, 0.4537242651, 1])
shatter_7 = Shatter(Curve=crv_13, Parameters=graph_11)
item_9 = ListItem(List=shatter_7, Index=0, Wrap=True)

randcol_2 = RandomColor(Data=tstat_2.Paths, Seed=2, FastMode=False)
shatter_8 = Shatter(Curve=crv_4, Parameters=graph_11)
item_10 = ListItem(List=shatter_8, Index=0, Wrap=True)

col_3 = Colour(graft_2)
previewlw_15 = CustomPreviewLineweights(Geometry=item_10, Shader=col_3, Thickness="1", Absolute=False)
end_6 = EndPoints(Curve=item_10)  # -> Start, End
pt_43 = Point(end_6.Start)
pt_44 = Point(end_6.End)
dots_2 = DotDisplay(Point=pt_44, Colour=col_3, Size=Slider(9.1, range=0..10))

col_4 = Colour(graft)
previewlw_16 = CustomPreviewLineweights(Geometry=item_9, Shader=col_4, Thickness="1", Absolute=False)
end_7 = EndPoints(Curve=item_9)  # -> Start, End
pt_45 = Point(end_7.Start)
pt_46 = Point(end_7.End)
dots_3 = DotDisplay(Point=pt_46, Colour=col_4, Size=Slider(9.1, range=0..10))

# ==== cluster Cluster
C = ClusterInput()
F = ClusterInput()
bbox = BoundingBox(Content=C, Plane=PlaneXY(0, 0, 0))  # -> Box, Box_2
debrep = DeconstructBrep(Brep=bbox.Box)  # -> Faces, Edges, Vertices
item = ListItem(List=debrep.Faces, Index="5", Wrap=True)
Z = UnitZ(Factor=F)
move = Move(Geometry=item, Motion=Z)  # -> Geometry, Transform
N = ClusterInput()
popgeo = PopulateGeometry(Geometry=move.Geometry, Count=N, Seed=1)
P = ClusterOutput(popgeo)

# ==== cluster Cluster_2
geo = ClusterInput()
N = ClusterInput()
S = ClusterInput()
geo_2 = Geometry(geo)
popgeo = PopulateGeometry(Geometry=geo_2, Count=N, Seed=S)
t = ClusterInput()
flip = FlipMatrix(Data=popgeo)
intcrv = Interpolate(Vertices=flip, Degree=3, Periodic=invert(False), KnotStyle=1)  # -> flatten(Curve), Length, Domain
crv = Curve(reparameterize(intcrv.Curve))
eval = EvaluateCurve(Curve=crv, Parameter=t)  # -> Point, Tangent, Angle
pt = Point(eval.Point)
pt_2 = ClusterOutput(pt)

# ==== cluster Dir
P = ClusterInput()
cir = Circle(Plane=P, Radius=Slider(15, range=0..100))
t = ClusterInput()
eval = EvaluateCurve(Curve=reparameterize(cir), Parameter=t)  # -> Point, Tangent, Angle
ln = Line(StartPoint=P, EndPoint=eval.Point)
vec = Vector(ln)
vec_2 = ClusterOutput(vec)

# ==== cluster GPt
G = ClusterInput()
F = ClusterInput()
N = ClusterInput()
center = Center(Geometric=G)  # -> Center, Dimension
scale = Scale(Geometry=G, Center=center.Center, Factor="0.8")  # -> Geometry, Transform
xy = XYPlane(Origin=center.Center)
popgeo = PopulateGeometry(Geometry=scale.Geometry, Count=N, Seed=1)
Z = UnitZ(Factor=F)
project = Project(Geometry=popgeo, Plane=xy)  # -> Geometry, Transform
move = Move(Geometry=project.Geometry, Motion=Z)  # -> Geometry, Transform
G_2 = ClusterOutput(move.Geometry)
